# Grasshopper definition DeBoorAlgorithmNurbs.gh (Grasshopper 1.0.7)

isperiodic = BooleanToggle(False)
pt = Point(Point(-359.1650243, 101.9842071, 0))
pt_2 = Point([Point(-364.95652, 17.7682542, 0), Point(-385.0154847, 77.43081609, 0), Point(-321.7525958, 83.08847282, 0), Point(-343.8688903, 32.16956224, 0), Point(-292.4356473, 18.79691906, 0), Point(-278.5486717, 61.48651075, 0), Point(-223.5151017, 37.82721897, 0)])
pt_3 = Point([Point(19.13106505, 37.32878588, 0), Point(10.71774169, 77.18137019, 0), Point(32.41525982, 90.24416172, 0), Point(88.43028111, 90.68696821, 0), Point(69.83240843, 41.09264107, 0), Point(109.906396, 64.11857867, 0)])
lng = ListLength(List=pt_3)
cir = Circle(Plane=PlaneXY(168.0102357, 67.28850409, 0), Radius="30")
knots = KnotVector(Count=lng, Degree="3", Periodic=isperiodic)
cp = ControlPoints(Curve=cir)  # -> Points, Weights, Knots
lng_2 = ListLength(List=pt_2)
panel = Panel(knots)
item = ListItem(List=cp.Knots, Index=-1, Wrap=True)
item_2 = ListItem(List=knots, Index=-1, Wrap=True)
remap = RemapNumbers(Value=Slider(0.384, range=0..1), Source=Domain(0, 1), Target=item)  # -> Mapped, Clipped
subtraction = Subtraction(A=lng_2, B="1")
remap_2 = RemapNumbers(Value=Slider(0.137, range=0..1), Source=Domain(0, 1), Target=item_2)  # -> Mapped, Clipped
panel_2 = Panel(remap.Mapped)
beziercurve = BezierCurve(pts=pt_2, funLength="100", funPosition=pt, textHeight="3", nums="50", u=Slider(0.769, range=0..1))  # -> basisFunction, legend, curvePoints, pointAtU; inputs pts: list of Point3d, funPosition: Point3d, nums: Int32
# ---------- beziercurve: Python ----------
#coding=utf-8
################################################################################
# BezierCurve.py
# Copyright (c) 2020.6 mahaidong
# Supported by ikuku.cn & caad.xyz 
# See License in the root of this repository for details.
################################################################################

import rhinoscriptsyntax as rs
import Rhino
from TextGoo import TextGoo
import ghpythonlib.treehelpers as th

class BezierCurve(object):

    def __init__(self, pts, textHeight):
        self.pts = pts
        self.legend = []
        self.textHeight = textHeight
        self.basisStr()
    
    def basisStr(self):
        n = len(self.pts)
        for i in range(n):
            text0 = BezierCurve.superscript("",'u',i)
            text1 = BezierCurve.superscript(text0, '(1-u)',n-1-i)
            if BezierCurve.binomial(n-1,i)==1:
                text = text0+text1+"•P"+str(i)
            else:
                text = str(BezierCurve.binomial(n-1,i))+"•"+text0+text1+"•P"+str(i)

            plane = Rhino.Geometry.Plane(self.pts[i], Rhino.Geometry.Vector3d(0,0,1))
            text3d = TextGoo(Rhino.Display.Text3d( text, plane, self.textHeight ))
            self.legend.append(text3d)
    
    def basisFunction(self,i,l, origin,nums ):
        pts = []
        n = len(self.pts)
        for j in range(nums+1):
            x = origin.X + l*j/nums
            y = origin.Y + l*BezierCurve.binomial(n-1,i)*( (j/nums)**i)*((1-j/nums)**(n-1-i))
            pts.append( Rhino.Geometry.Point3d(x,y,0) )
        return pts

    # algorithm: https://pages.mtu.edu/~shene/COURSES/cs3621/NOTES/notes.html
    def calculatePoint( self, u ): 
        p = None
        n = len(self.pts)
        for i in range(n):
            if i == 0:
                p = BezierCurve.binomial(n-1,i)*(u**i)*((1-u)**(n-1-i))*self.pts[i]
            else: 
                p += BezierCurve.binomial(n-1,i)*(u**i)*((1-u)**(n-1-i))*self.pts[i]
        return p

    def drawCurvePts(self,nums):
        pts = []
        for i in range(nums+1):
            pts.append(rs.AddPoint( self.calculatePoint( i/float(nums) ) ) )
        return pts
    

    @staticmethod
    def superscript(p,u,i):
        result =""
        if i==0:
            pass
        elif i==1:
            result +=u 
        elif i==2:
            result +=u+'\xB2'
        elif i==3:
            result +=u+'\xB3'
        else:
            result +=u+'^'+str(i)
        if p is "":
            return result
        else:
            if result is "":
                return ""
            else:
                return '•'+result

    @staticmethod
    def binomial(n, k):
        """
        A fast way to calculate binomial coefficients by Andrew Dalke.
        See http://stackoverflow.com/questions/3025162/statistics-combinations-in-python
        """
        if 0 <= k <= n:
            ntok = 1
            ktok = 1
            for t in range(1, min(k, n - k) + 1):
                ntok *= n
                ktok *= t
                n -= 1
            return ntok // ktok
        else:
            return 0

bc = BezierCurve(pts, textHeight)
legend = bc.legend
curvePoints = bc.drawCurvePts(nums)
pointAtU = []
pointAtU.append(bc.calculatePoint(u))
pointAtU.append(funPosition+Rhino.Geometry.Point3d(u*funLength,0,0))

basisFunction = []
for i in range(len(pts)):
    basisFunction.append(bc.basisFunction(i,funLength,funPosition,nums))
basisFunction = th.list_to_tree(basisFunction, source=[0,0])
# ---------- end beziercurve ----------
range = Range(Domain=Domain(0, 1), Steps=subtraction)
panel_3 = Panel(cp.Points)
panel_4 = Panel(cp.Knots)
panel_5 = Panel(cp.Weights)
panel_6 = Panel(remap_2.Mapped)
nurbs = NurbsCurve(Vertices=pt_2, Degree=subtraction, Periodic=False)  # -> Curve, Length, Domain
multiplication = Multiplication(A="100", B=0.05)
multiplication_2 = Multiplication(A=range, B=0.9)
path = FilePath("C:\msys64\home\mahai\repos\debooralgorithm\src\DeBoorAlgorithmNurbs.py")
hsl = ColourHSL(Alpha=1, Hue=multiplication_2, Saturation=1, Luminance=0.5)
cir_2 = Circle(Plane=beziercurve.pointAtU, Radius=multiplication)
file = ReadFile(File=path, PerLineParse=False)
col = Colour(RGB(255, 255, 255))
flip = FlipMatrix(Data=beziercurve.legend)
flip_2 = FlipMatrix(Data=hsl)
debooralgorithmnurbs = GhPythonScript(Code=file, Points=pt_3, Knots=knots, Degree="3", U=remap_2.Mapped, IsPeriodic=isperiodic, IsRational=Toggle(False))  # -> Out, CurvePoints, DeBoorlines, PointAtU
path_2 = FilePath("C:\msys64\home\mahai\repos\debooralgorithm\src\DeBoorAlgorithmNurbs.py")
preview = CustomPreview(Geometry=flip, Material=flip_2)
preview_2 = CustomPreview(Geometry=beziercurve.basisFunction, Material=flip_2)
preview_3 = CustomPreview(Geometry=[beziercurve.pointAtU, cir_2, pt_2], Material=col)
file_2 = ReadFile(File=path_2, PerLineParse=False)
debooralgorithmnurbs_2 = GhPythonScript(
    Code=file_2,
    Points=panel_3,
    Weights=panel_5,
    Knots=panel_4,
    Degree="2",
    U=remap.Mapped,
    IsPeriodic=Toggle(True),
    IsRational=Toggle(True))  # -> CurvePoints, DeBoorlines, PointAtU
col_2 = Colour(RGB(255, 255, 255))
preview_4 = CustomPreview(Geometry=[debooralgorithmnurbs.DeBoorlines, debooralgorithmnurbs.PointAtU], Material=col_2)
col_3 = Colour(RGB(255, 255, 255))
preview_5 = CustomPreview(Geometry=[debooralgorithmnurbs_2.PointAtU, debooralgorithmnurbs_2.DeBoorlines], Material=col_3)
