# Grasshopper definition DeBoorAlgorithmNurbs.gh (Grasshopper 1.0.7)

isperiodic = BooleanToggle(False)
path = FilePath("C:\msys64\home\mahai\repos\debooralgorithm\src\BezierCurve.py")
pt = Point([Point(10.34607845, 50.41064445, 0), Point(-18.72004734, 97.36361689, 0), Point(22.8029895, 118.1251353, 0), Point(70.07536992, 116.5280954, 0), Point(83.4905049, 103.1129605, 0), Point(58.57668279, 83.30966595, 0), Point(66.88129016, 56.79880397, 0), Point(79.01879324, 72.44979478, 0), Point(104.5714313, 77.87973037, 0), Point(112.8760387, 57.75702789, 0)])
pt_2 = Point([Point(-123.6445423, 21.56189085, 0), Point(-154.8086697, 49.75800614, 0), Point(-96.93243308, 60.14604861, 0), Point(-63.17129505, 46.41899248, 0), Point(-81.35036937, 26.75591209, 0)])
file = ReadFile(File=path, PerLineParse=False)
lng = ListLength(List=pt)
cir = Circle(Plane=PlaneXY(224.774899, 82.02928801, 0), Radius="30")
knots = KnotVector(Count=lng, Degree="5", Periodic=isperiodic)
nurbs = NurbsCurve(Vertices=pt, Degree="5", Periodic=False)  # -> Curve, Length, Domain
cp = ControlPoints(Curve=cir)  # -> Points, Weights, Knots
lng_2 = ListLength(List=pt_2)
pt_3 = Point(Point(-141.8236166, 68.6790835, 0))
item = ListItem(List=cp.Knots, Index=-1, Wrap=True)
item_2 = ListItem(List=knots, Index=-1, Wrap=True)
panel = Panel(knots)
subtraction = Subtraction(A=lng_2, B="1")
remap = RemapNumbers(Value=Slider(0.493, range=0..1), Source=Domain(0, 1), Target=item)  # -> Mapped, Clipped
remap_2 = RemapNumbers(Value=Slider(0.982, range=0..1), Source=Domain(0, 1), Target=item_2)  # -> Mapped, Clipped
panel_2 = Panel(remap.Mapped)
beziercurve = GhPythonScript(Code=file, Pts=pt_2, FunLength="100", FunPosition=pt_3, TextHeight="3", Nums="50", U=Slider(1, range=0..1))  # -> Out, BasisFunction, Legend, CrvPoints, U2p
panel_3 = Panel(cp.Points)
panel_4 = Panel(cp.Knots)
panel_5 = Panel(cp.Weights)
nurbs_2 = NurbsCurve(Vertices=pt_2, Degree=subtraction, Periodic=False)  # -> Curve, Length, Domain
panel_6 = Panel(remap_2.Mapped)
path_2 = FilePath("C:\msys64\home\mahai\repos\debooralgorithm\src\DeBoorAlgorithmNurbs.py")
file_2 = ReadFile(File=path_2, PerLineParse=False)
debooralgorithmnurbs = GhPythonScript(Code=file_2, Points=pt, Knots=knots, Degree="5", U=remap_2.Mapped, IsPeriodic=isperiodic, IsRational=Toggle(False))  # -> Out, CurvePoints, DeBoorPts, DeBoorlines, PointAtU
path_3 = FilePath("C:\msys64\home\mahai\repos\debooralgorithm\src\DeBoorAlgorithmNurbs.py")
file_3 = ReadFile(File=path_3, PerLineParse=False)
debooralgorithmnurbs_2 = GhPythonScript(
    Code=file_3,
    Points=panel_3,
    Weights=panel_5,
    Knots=panel_4,
    Degree="2",
    U=remap.Mapped,
    IsPeriodic=Toggle(False),
    IsRational=Toggle(True))  # -> CurvePoints, DeBoorPts, DeBoorlines, PointAtU
col = Colour(RGB(255, 255, 255))
preview = CustomPreview(Geometry=debooralgorithmnurbs.PointAtU, Material=col)
col_2 = Colour(RGB(255, 255, 255))
preview_2 = CustomPreview(Geometry=[debooralgorithmnurbs_2.PointAtU, debooralgorithmnurbs_2.DeBoorlines], Material=col_2)
