# Grasshopper definition DeBoorAlgorithmNurbsPy.gh (Grasshopper 1.0.7)

isperiodic = BooleanToggle(False)
path = FilePath("C:\msys64\home\mahai\repos\debooralgorithm\src\DeBoorAlgorithmNurbs.py")
pt = Point([Point(-37.56954049, -10.93893819, 0), Point(0.1963165841, 19.96039942, 0), Point(12.05666839, -15.30854149, 0), Point(36.2455438, 7.007646784, 0), Point(49.97858273, -8.442022021, 0), Point(58.71778933, 13.40599447, 0)])
crv = Curve(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)
cp = ControlPoints(Curve=crv)  # -> Points, Weights, Knots
lng = ListLength(List=pt)
knots = KnotVector(Count=lng, Degree="4", Periodic=isperiodic)
item = ListItem(List=cp.Knots, Index=-1, Wrap=True)
remap = RemapNumbers(Value=Slider(0.929, range=0..1), Source=Domain(0, 1), Target=item)  # -> Mapped, Clipped
panel = Panel(knots)
file = ReadFile(File=path, PerLineParse=False)
panel_2 = Panel(remap.Mapped)
item_2 = ListItem(List=knots, Index=-1, Wrap=True)
remap_2 = RemapNumbers(Value=Slider(0.931, range=0..1), Source=Domain(0, 1), Target=item_2)  # -> Mapped, Clipped
panel_3 = Panel(cp.Points)
panel_4 = Panel(cp.Knots)
panel_5 = Panel(cp.Weights)
panel_6 = Panel(remap_2.Mapped)
python = GhPythonScript(Code=file, Points=pt, Knots=knots, Degree="4", U=remap_2.Mapped, IsPeriodic=isperiodic, IsRational=Toggle(False))  # -> Out, CurvePoints, DeBoorlines, PointAtU
debooralgorithmnurbs = GhPythonScript(
    Code=file,
    Points=panel_3,
    Weights=panel_5,
    Knots=panel_4,
    Degree="2",
    U=remap.Mapped,
    IsPeriodic=Toggle(True),
    IsRational=Toggle(True))  # -> CurvePoints, DeBoorlines, PointAtU
col = Colour(RGB(255, 255, 255))
preview = CustomPreview(Geometry=[python.DeBoorlines, python.PointAtU], Material=col)
col_2 = Colour(RGB(255, 255, 255))
preview_2 = CustomPreview(Geometry=[debooralgorithmnurbs.PointAtU, debooralgorithmnurbs.DeBoorlines], Material=col_2)
